# Grasshopper definition Jaali Pavilion.gh (Grasshopper 1.0.8)
# plug-ins: Parakeet, LunchBox

brep = Brep(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)
deconstruct_brep = DeconstructBrep(Brep=brep)  # -> reparameterize(Faces), Edges, Vertices
list_item = ListItem(List=deconstruct_brep.Faces, Index=Slider(1, range=0..10), Wrap=True)
number_slider = Slider(0.9, range=0..1)
number_slider_2 = Slider(0.1, range=0..0.1)
construct_domain² = ConstructDomain²(UMin=number_slider_2, UMax=number_slider, VMin=number_slider_2, VMax=number_slider)
isotrim = Isotrim(Surface=list_item, Domain=construct_domain²)
brep_edges = BrepEdges(Brep=isotrim)  # -> Naked, Interior, NonManifold
surface_split = SurfaceSplit(Surface=list_item, Curves=brep_edges.Naked)
divide_domain² = DivideDomain²(Domain=isotrim, UCount=Slider(15, range=0..100), VCount=Slider(15, range=0..100))
unit_z = UnitZ(Factor=Slider(13, range=0..100))  # -> expr("-x", UnitVector)
list_item_2 = ListItem(List=surface_split, Index=Slider(0, range=0..1), Wrap=True)
extrude = Extrude(Base=list_item_2, Direction=unit_z)
quad_panels = QuadPanels(Surface=isotrim, UDivisions=10, VDivisions=10)
number_slider_3 = Slider(1, range=0..100)
star_pattern_i = StarPatternI(
    BaseGrid=quad_panels,
    Angle=number_slider_3,
    Distance=number_slider_3,
    ShiftSize=number_slider_3,
    BulgeFactor=number_slider_3)
